# Grasshopper definition 220403_meshToThreejs.gh (Grasshopper 1.0.7)
# plug-ins: glTFexporter

# GH File Location
relative_gh_file_location = RelativePath()

# ---- group: Inputs
brep_buildings = Brep(flatten([<brep referenced from the Rhino model> x2492]))
mesh_forestfloor = Mesh([<mesh referenced from the Rhino model> x9])
mesh_cliffface = Mesh([<mesh referenced from the Rhino model> x9])
mesh_cityfloor = Mesh([<mesh referenced from the Rhino model> x4])
brep_historical = Brep([<brep referenced from the Rhino model> x2])
mesh_riverbed = Mesh(<mesh referenced from the Rhino model>)
brep_cameras = Brep([<brep referenced from the Rhino model> x4])
mesh_ponds = Mesh([<mesh referenced from the Rhino model> x1121])
mesh_roads = Mesh([<mesh referenced from the Rhino model> x1120])

# ----
panel = Panel(relative_gh_file_location)
mesh_building = Mesh(brep_buildings)
join = BrepJoin(Breps=brep_buildings)  # -> Breps, Closed
mjoin = MeshJoin(Meshes=mesh_building)
fmerge = MergeFaces(Brep=join.Breps)  # -> Breps, Before, After
nickname = RelativePath()
panel_2 = Panel("-10,-10,-10")
mesh_building_2 = Mesh(mjoin)
concat = Concatenate(FragmentA=nickname, FragmentB="/materials/disc.png")
nickname_2 = RelativePath()
concat_2 = Concatenate(FragmentA=nickname_2, FragmentB="/materials/cross.png")

# ---- group: Points
medges = MeshEdges(Mesh=mesh_cliffface)  # -> NakedEdges, InteriorEdges, NonManifoldEdges
medges_2 = MeshEdges(Mesh=mesh_forestfloor)  # -> NakedEdges, InteriorEdges, NonManifoldEdges
medges_3 = MeshEdges(Mesh=mesh_riverbed)  # -> NakedEdges, InteriorEdges, NonManifoldEdges
medges_4 = MeshEdges(Mesh=mesh_cityfloor)  # -> NakedEdges, InteriorEdges, NonManifoldEdges
medges_5 = MeshEdges(Mesh=mesh_ponds)  # -> NakedEdges, InteriorEdges, NonManifoldEdges
end = EndPoints(Curve=[medges.NakedEdges, medges.InteriorEdges, medges.NonManifoldEdges])  # -> Start, End
end_2 = EndPoints(Curve=[medges_2.NakedEdges, medges_2.InteriorEdges, medges_2.NonManifoldEdges])  # -> Start, End
end_3 = EndPoints(Curve=[medges_3.NakedEdges, medges_3.InteriorEdges])  # -> Start, End
concat_3 = Concatenate(FragmentA=relative_gh_file_location, FragmentB="/materials/cross2.png")
end_4 = EndPoints(Curve=[medges_4.NakedEdges, medges_4.InteriorEdges])  # -> Start, End
end_5 = EndPoints(Curve=medges_5.InteriorEdges)  # -> Start, End
cullpt = CullDuplicates(Points=[end.Start, end.End], Tolerance=0.1, CullMode=3)  # -> Points, Indices, Valence
cullpt_2 = CullDuplicates(Points=[end_2.Start, end_2.End], Tolerance=0.1, CullMode=3)  # -> Points, Indices, Valence
cullpt_3 = CullDuplicates(Points=[end_3.Start, end_3.End], Tolerance=0.1, CullMode=3)  # -> Points, Indices, Valence
cullpt_4 = CullDuplicates(Points=[end_4.Start, end_4.End], Tolerance=0.1, CullMode=3)  # -> Points, Indices, Valence
texture = Texture(ImagePath=concat_3)
cullpt_5 = CullDuplicates(Points=[end_5.Start, end_5.End], Tolerance=0.1, CullMode=3)  # -> Points, Indices, Valence
pointsmat = PointsMaterial(
    Color=ColourSwatch(SwatchColor=RGB(152, 212, 198)),
    Size=Slider(100, range=0..1000),
    SizeAttenuation=Toggle(True),
    AlphaTest=Slider(0, range=0..1))
pointsmat_2 = PointsMaterial(
    Color=ColourSwatch(SwatchColor=RGB(118, 191, 0)),
    Size=Slider(85, range=0..100),
    SizeAttenuation=Toggle(True),
    AlphaTest=0.5)
pointsmat_3 = PointsMaterial(
    Color=ColourSwatch(SwatchColor=RGB(150, 144, 144)),
    Size=Slider(60, range=0..1000),
    SizeAttenuation=Toggle(True),
    AlphaTest=0.5)
pointsmat_4 = PointsMaterial(
    Color=ColourSwatch(SwatchColor=RGB(167, 224, 235)),
    Size=Slider(100, range=0..1000),
    SizeAttenuation=Toggle(True),
    AlphaTest=Slider(0.2, range=0..1))
pointsmat_5 = PointsMaterial(
    Color=ColourSwatch(SwatchColor=RGB(0, 143, 112)),
    Size=Slider(85, range=0..100),
    SizeAttenuation=Toggle(True),
    AlphaTest=0.5)
points = Points(Points=cullpt.Points, Name="cliffFace", PointsMaterial=pointsmat_5, DecimalAccuracy=3)  # -> flatten(Geometry)
points_2 = Points(Points=cullpt_2.Points, Name="forestFloor", PointsMaterial=pointsmat_2, DecimalAccuracy=3)  # -> flatten(Geometry)
points_3 = Points(Points=cullpt_3.Points, Name="riverbed", PointsMaterial=pointsmat, DecimalAccuracy=3)  # -> flatten(Geometry)
points_4 = Points(Points=cullpt_4.Points, Name="cityFloor", PointsMaterial=pointsmat_3, DecimalAccuracy=3)  # -> flatten(Geometry)
points_5 = Points(Points=cullpt_5.Points, Name="ponds", PointsMaterial=pointsmat_4, DecimalAccuracy=3)  # -> flatten(Geometry)

# ----
number_slider = Slider(0.3, range=0..10)
edges = BrepEdges(Brep=simplify(flatten(fmerge.Breps)))  # -> Naked, Interior, NonManifold
texture_2 = Texture(ImagePath=concat)
texture_3 = Texture(ImagePath=concat_2)
pointsmat_6 = PointsMaterial(Color=RGB(255, 255, 255), Size=Slider(0.2, range=0..10), SizeAttenuation=True, AlphaMap=texture_2, AlphaTest=0.5)
linebasicmat = LineBasicMaterial(Color=ColourSwatch(SwatchColor=RGB(199, 199, 199)), LineWidth=Slider(2, range=0..10))
standardmat = MeshStandardMaterial(Color=RGB(255, 255, 255), Opacity="0", Roughness=1, Metalness=0.5, Emissive=RGB(0, 0, 0), EmissiveIntensity=1)
standardmat_2 = MeshStandardMaterial(
    Color=ColourSwatch(SwatchColor=RGB(15, 255, 243)),
    Opacity=1,
    Roughness=1,
    Metalness=0.5,
    Emissive=RGB(0, 0, 0),
    EmissiveIntensity=1)
standardmat_3 = MeshStandardMaterial(
    Color=ColourSwatch(SwatchColor=RGB(33, 33, 33)),
    Opacity=Slider(1, range=0..1),
    Roughness=1,
    Metalness=0.5,
    Emissive=RGB(0, 0, 0),
    EmissiveIntensity=1)
standardmat_4 = MeshStandardMaterial(
    Color=ColourSwatch(SwatchColor=RGB(247, 57, 165)),
    Opacity=1,
    Roughness=1,
    Metalness=0.5,
    Emissive=RGB(0, 0, 0),
    EmissiveIntensity=1)
line = Line(Line=edges.Interior, LineMaterial=linebasicmat, DecimalAccuracy=3)
mesh = Mesh(Mesh=mesh_roads, Name="roads", Material=standardmat, DecimalAccuracy=3)
hemilight = HempisphereLight(
    Color=ColourSwatch(SwatchColor=RGB(178, 194, 194)),
    GroundColor=ColourSwatch(SwatchColor=RGB(0, 0, 0)),
    Intensity=Slider(5, range=0..10),
    Name="hemisphere light")
ambientlight = AmbientLight(Color=ColourSwatch(SwatchColor=RGB(255, 255, 255)), Intensity=Slider(0.05, range=0..1), Name="ambient light")
mesh_2 = Mesh(Mesh=brep_cameras, Name="liveCam1", Material=standardmat_2, DecimalAccuracy=3)
mesh_3 = Mesh(Mesh=mesh_building_2, Name="buildings", Material=standardmat_3, DecimalAccuracy=3)
mesh_4 = Mesh(Mesh=brep_historical, Name="historicalPt", Material=standardmat_4, DecimalAccuracy=3)
panel_3 = Panel("2")
fog = Fog(Color=ColourSwatch(SwatchColor=RGB(20, 20, 20)), Near="500", Far=100)

scene = CompileScene(
    Objects=[hemilight, points_5, points, points_2, points_3, ambientlight, points_4, mesh, mesh_3, mesh_2, mesh_4],
    BackgroundColor=ColourSwatch(SwatchColor=RGB(0, 0, 0)))
button = Button()
concat_4 = Concatenate(FragmentA=relative_gh_file_location, FragmentB="/assets")

serialize = SerializeObject(Object3d=scene, Minify=False, Run=button)

# ---- group: Serve Your Website
concat_5 = Concatenate(FragmentA=relative_gh_file_location, FragmentB="/www")
http = HTTPServer(Path=concat_5, Run=Toggle(True))

# ----
writetxt = WriteTextFile(Path=concat_4, FileName="groundPoints.json", Data=serialize, Write=button)

# ---- group: Black Surface
merge = Merge(Data1=mesh_cliffface, Data2=mesh_forestfloor, Data3=mesh_riverbed, Data4=mesh_cityfloor)
Z = UnitZ(Factor="-200")
mesh_5 = Mesh(merge)
move = Move(Geometry=mesh_5, Motion=Z)  # -> Geometry, Transform
standardmat_5 = MeshStandardMaterial(
    Color=ColourSwatch(SwatchColor=RGB(51, 51, 51)),
    Opacity=1,
    Roughness=1,
    Metalness=0.5,
    Emissive=RGB(0, 0, 0),
    EmissiveIntensity=1)

# ----
mesh_6 = Mesh(move.Geometry)

# ---- group: Black Surface (continued)
mesh_7 = Mesh(Mesh=mesh_6, Material=standardmat_5, DecimalAccuracy=3)
