# Grasshopper definition meshToThreejs.gh (Grasshopper 1.0.7)
# plug-ins: glTFexporter

# GH File Location
relative_gh_file_location = RelativePath()

# ---- group: old from example
panel = Panel("/materials/leather_red_02_1k_jpg/leather_red_02_rough_1k.jpg")
panel_2 = Panel("/materials/leather_red_02_1k_jpg/leather_red_02_coll1_1k.jpg")
concat = Concatenate(FragmentA=relative_gh_file_location, FragmentB=panel_2)
concat_2 = Concatenate(FragmentA=relative_gh_file_location, FragmentB="/materials/leather_red_02_1k_jpg/leather_red_02_nor_1k.jpg")
concat_3 = Concatenate(FragmentA=relative_gh_file_location, FragmentB=panel)
imgsettings = ImageSettings(Saturation=Slider(-0.75, range=-1..1), Contrast=Slider(-0.5, range=-1..1), Lightness=0)
texture = Texture(ImagePath=concat, ImageSettings=imgsettings)
texture_2 = Texture(ImagePath=concat_3)
texture_3 = Texture(ImagePath=concat_2)
meshstandardmaps = MeshStandardMaterialMaps(
    Map=texture,
    AlphaTest=0.5,
    BumpScale=1,
    DisplacementScale=1,
    NormalMap=texture_3,
    EnvMapIntensity=1,
    RoughnessMap=texture_2,
    AoMapIntensity=1)

# ----
panel_3 = Panel(relative_gh_file_location)
autowire = AutoWire(button=Button())  # inputs button: Boolean
# ---------- autowire: Python ----------
from Grasshopper.Kernel import *
import clr
import System.Drawing
sources = []
this = ghenv.Component
this.Name = "AutoWire"
this.Description = "Select all floating parameters to connect and press the button"
doc = this.OnPingDocument()
pos_x = 0
for obj in doc.SelectedObjects():
    if clr.GetClrType(IGH_Param).IsAssignableFrom(obj.GetType()):
      sources.append([obj, obj.Attributes.Pivot.Y])
      pos_x = max(pos_x, obj.Attributes.Bounds.Right)

if sources and button:
    sources.sort(key = lambda tup: tup[1])
    pos_y = sum([tup[1] for tup in sources]) * 1.0 / len(sources)
    pos_x += 100

    p = Parameters.Param_GenericObject() 
    doc.AddObject(p, False)
    p.Attributes.Pivot = System.Drawing.PointF(pos_x, pos_y) 
    p.Attributes.ExpireLayout()
    for s,_ in sources:
        p.AddSource(s)
# ---------- end autowire ----------
nickname = RelativePath()
concat_4 = Concatenate(FragmentA=nickname, FragmentB="/materials/disc.png")
nickname_2 = RelativePath()
concat_5 = Concatenate(FragmentA=nickname_2, FragmentB="/materials/cross.png")
number_slider = Slider(0.3, range=0..10)
texture_4 = Texture(ImagePath=concat_4)
texture_5 = Texture(ImagePath=concat_5)
pointsmat = PointsMaterial(Color=RGB(255, 255, 255), Size=Slider(0.2, range=0..10), SizeAttenuation=True, AlphaMap=texture_4, AlphaTest=0.5)

# ---- group: Mesh / Serve Your Website
concat_6 = Concatenate(FragmentA=relative_gh_file_location, FragmentB="/www")
http = HTTPServer(Path=concat_6, Run=Toggle(True))

# ----
panel_4 = Panel("-10,-10,-10")
neg = Negative(Value=Slider(31, range=0..100))
neg_2 = Negative(Value=Slider(46, range=0..100))
pt = Point(<point referenced from the Rhino model>)
dirlight = DirectionalLight(
    Position=pt,
    Color=RGB(255, 255, 255),
    Intensity=Slider(0.5, range=0..1),
    Name="directional light",
    CastShadow=Toggle(True),
    ShadowTop=Slider(70, range=0..100),
    ShadowBottom=neg,
    ShadowRight=Slider(36, range=0..100),
    ShadowLeft=neg_2,
    ShadowNear=0,
    ShadowFar=Slider(221, range=0..1000))  # -> Helper, Light
hemilight = HempisphereLight(
    Color=ColourSwatch(SwatchColor=RGB(178, 194, 194)),
    GroundColor=ColourSwatch(SwatchColor=RGB(0, 0, 0)),
    Intensity=Slider(10, range=0..10),
    Name="hemisphere light")
ambientlight = AmbientLight(Color=ColourSwatch(SwatchColor=RGB(255, 255, 255)), Intensity=0.5, Name="ambient light")
preview = CustomPreview(
    Geometry=dirlight.Helper,
    Material={diffuse=RGB(221, 160, 221), emission=RGB(66, 48, 66), shine=0.5, specular=RGB(255, 255, 255), transparency=0})
panel_5 = Panel("2")
fog = Fog(Color=ColourSwatch(SwatchColor=RGB(20, 20, 20)), Near="500", Far=100)

# ---- group: Serve Your Website
concat_7 = Concatenate(FragmentA=relative_gh_file_location, FragmentB="/www")
http_2 = HTTPServer(Path=concat_7, Run=Toggle(True))

# ---- group: Mesh
standardmat = MeshStandardMaterial(
    Color=ColourSwatch(SwatchColor=RGB(54, 76, 16)),
    Opacity=1,
    Roughness=1,
    Metalness=0.5,
    Emissive=RGB(0, 0, 0),
    EmissiveIntensity=1)
standardmat_2 = MeshStandardMaterial(
    Color=ColourSwatch(SwatchColor=RGB(66, 27, 27)),
    Opacity=1,
    Roughness=1,
    Metalness=0.5,
    Emissive=RGB(0, 0, 0),
    EmissiveIntensity=1)
mesh = Mesh([<mesh referenced from the Rhino model> x8])
mesh_2 = Mesh([<mesh referenced from the Rhino model> x11])
standardmat_3 = MeshStandardMaterial(
    Color=ColourSwatch(SwatchColor=RGB(159, 181, 176)),
    Opacity=1,
    Roughness=Slider(0.7, range=0..1),
    Metalness=Slider(0.2, range=0..1),
    Emissive=RGB(0, 0, 0),
    EmissiveIntensity=1)
standardmat_4 = MeshStandardMaterial(
    Color=ColourSwatch(SwatchColor=RGB(159, 181, 176)),
    Opacity=1,
    Roughness=Slider(0.7, range=0..1),
    Metalness=Slider(0.2, range=0..1),
    Emissive=RGB(0, 0, 0),
    EmissiveIntensity=1)
shadowmat = ShadowMaterial(Color=RGB(0, 0, 0), Opacity=Slider(0.1, range=0..1))
neg_3 = Negative(Value=Slider(31, range=0..100))
neg_4 = Negative(Value=Slider(46, range=0..100))
mesh_3 = Mesh(<mesh referenced from the Rhino model>)
mesh_4 = Mesh([<mesh referenced from the Rhino model> x4])
pt_2 = Point(<point referenced from the Rhino model>)
mesh_5 = Mesh([<mesh referenced from the Rhino model> x443])
dirlight_2 = DirectionalLight(
    Position=pt_2,
    Color=RGB(255, 255, 255),
    Intensity=Slider(0.5, range=0..1),
    Name="directional light",
    CastShadow=Toggle(True),
    ShadowTop=Slider(70, range=0..100),
    ShadowBottom=neg_3,
    ShadowRight=Slider(36, range=0..100),
    ShadowLeft=neg_4,
    ShadowNear=0,
    ShadowFar=Slider(221, range=0..1000))  # -> Helper, Light
hemilight_2 = HempisphereLight(
    Color=ColourSwatch(SwatchColor=RGB(196, 231, 255)),
    GroundColor=ColourSwatch(SwatchColor=RGB(217, 205, 189)),
    Intensity=Slider(2.2, range=0..10),
    Name="hemisphere light")
mesh_6 = Mesh(Mesh=mesh_5, Name="ponds", Material=shadowmat, DecimalAccuracy=3)
mesh_7 = Mesh(Mesh=mesh, Name="forestFloor", Material=standardmat, DecimalAccuracy=3)
mesh_8 = Mesh(Mesh=mesh_3, Name="cityFloor", Material=standardmat_3, DecimalAccuracy=3)
mesh_9 = Mesh(Mesh=mesh_4, Name="riverbed", Material=standardmat_4, DecimalAccuracy=3)
mesh_10 = Mesh(Mesh=mesh_2, Name="cliffFace", Material=standardmat_2, DecimalAccuracy=3)
preview_2 = CustomPreview(
    Geometry=dirlight_2.Helper,
    Material={diffuse=RGB(221, 160, 221), emission=RGB(66, 48, 66), shine=0.5, specular=RGB(255, 255, 255), transparency=0})

scene = CompileScene(Objects=[mesh_10, mesh_7, mesh_9, hemilight_2, dirlight_2.Light, mesh_8])
button = Button()
panel_6 = Panel("ground.json")
concat_8 = Concatenate(FragmentA=relative_gh_file_location, FragmentB="/www/assets")

serialize = SerializeObject(Object3d=scene, Minify=False, Run=button)
writetxt = WriteTextFile(Path=concat_8, FileName=panel_6, Data=serialize, Write=button)

# ---- group: Points
medges = MeshEdges(Mesh=mesh_2)  # -> NakedEdges, InteriorEdges, NonManifoldEdges
medges_2 = MeshEdges(Mesh=mesh)  # -> NakedEdges, InteriorEdges, NonManifoldEdges
medges_3 = MeshEdges(Mesh=mesh_4)  # -> NakedEdges, InteriorEdges, NonManifoldEdges
medges_4 = MeshEdges(Mesh=mesh_3)  # -> NakedEdges, InteriorEdges, NonManifoldEdges
medges_5 = MeshEdges(Mesh=mesh_5)  # -> NakedEdges, InteriorEdges, NonManifoldEdges
end = EndPoints(Curve=[medges.NakedEdges, medges.InteriorEdges, medges.NonManifoldEdges])  # -> Start, End
end_2 = EndPoints(Curve=[medges_2.NakedEdges, medges_2.InteriorEdges, medges_2.NonManifoldEdges])  # -> Start, End
end_3 = EndPoints(Curve=[medges_3.NakedEdges, medges_3.InteriorEdges, medges_3.NonManifoldEdges])  # -> Start, End
concat_9 = Concatenate(FragmentA=relative_gh_file_location, FragmentB="/materials/cross2.png")
end_4 = EndPoints(Curve=[medges_4.NakedEdges, medges_4.InteriorEdges])  # -> Start, End
end_5 = EndPoints(Curve=medges_5.InteriorEdges)  # -> Start, End
cullpt = CullDuplicates(Points=[end.Start, end.End], Tolerance=0.1, CullMode=3)  # -> Points, Indices, Valence
cullpt_2 = CullDuplicates(Points=[end_2.Start, end_2.End], Tolerance=0.1, CullMode=3)  # -> Points, Indices, Valence
cullpt_3 = CullDuplicates(Points=[end_3.Start, end_3.End], Tolerance=0.1, CullMode=3)  # -> Points, Indices, Valence
cullpt_4 = CullDuplicates(Points=[end_4.Start, end_4.End], Tolerance=0.1, CullMode=3)  # -> Points, Indices, Valence
texture_6 = Texture(ImagePath=concat_9)
cullpt_5 = CullDuplicates(Points=[end_5.Start, end_5.End], Tolerance=0.1, CullMode=3)  # -> Points, Indices, Valence
pointsmat_2 = PointsMaterial(
    Color=ColourSwatch(SwatchColor=RGB(152, 212, 198)),
    Size=Slider(100, range=0..1000),
    SizeAttenuation=Toggle(True),
    AlphaTest=Slider(0, range=0..1))
pointsmat_3 = PointsMaterial(
    Color=ColourSwatch(SwatchColor=RGB(131, 191, 34)),
    Size=Slider(85, range=0..100),
    SizeAttenuation=Toggle(True),
    AlphaTest=0.5)
pointsmat_4 = PointsMaterial(
    Color=ColourSwatch(SwatchColor=RGB(150, 144, 144)),
    Size=Slider(60, range=0..1000),
    SizeAttenuation=Toggle(True),
    AlphaTest=0.5)
pointsmat_5 = PointsMaterial(
    Color=ColourSwatch(SwatchColor=RGB(167, 224, 235)),
    Size=Slider(100, range=0..1000),
    SizeAttenuation=Toggle(True),
    AlphaTest=Slider(0.2, range=0..1))
pointsmat_6 = PointsMaterial(
    Color=ColourSwatch(SwatchColor=RGB(88, 115, 52)),
    Size=Slider(85, range=0..100),
    SizeAttenuation=Toggle(True),
    AlphaTest=0.5)
points = Points(Points=cullpt_2.Points, Name="forestFloor", PointsMaterial=pointsmat_3, DecimalAccuracy=3)  # -> flatten(Geometry)
points_2 = Points(Points=cullpt_3.Points, Name="riverbed", PointsMaterial=pointsmat_2, DecimalAccuracy=3)  # -> flatten(Geometry)
points_3 = Points(Points=cullpt.Points, Name="cliffFace", PointsMaterial=pointsmat_6, DecimalAccuracy=3)  # -> flatten(Geometry)
points_4 = Points(Points=cullpt_4.Points, Name="cityFloor", PointsMaterial=pointsmat_4, DecimalAccuracy=3)  # -> flatten(Geometry)
points_5 = Points(Points=cullpt_5.Points, Name="ponds", PointsMaterial=pointsmat_5, DecimalAccuracy=3)  # -> flatten(Geometry)

# ----
scene_2 = CompileScene(
    Objects=[hemilight, points_5, points_3, points, points_2, ambientlight, points_4],
    BackgroundColor=ColourSwatch(SwatchColor=RGB(0, 0, 0)),
    Fog=fog)
button_2 = Button()
concat_10 = Concatenate(FragmentA=relative_gh_file_location, FragmentB="/assets")

serialize_2 = SerializeObject(Object3d=scene_2, Minify=False, Run=button_2)
writetxt_2 = WriteTextFile(Path=concat_10, FileName="groundPoints.json", Data=serialize_2, Write=button_2)

# ---- group: Black Surface
merge = Merge(Data1=mesh_2, Data2=mesh, Data3=mesh_4, Data4=mesh_3)
Z = UnitZ(Factor="-200")
mesh_11 = Mesh(merge)
move = Move(Geometry=mesh_11, Motion=Z)  # -> Geometry, Transform
standardmat_5 = MeshStandardMaterial(
    Color=ColourSwatch(SwatchColor=RGB(51, 51, 51)),
    Opacity=1,
    Roughness=1,
    Metalness=0.5,
    Emissive=RGB(0, 0, 0),
    EmissiveIntensity=1)

# ----
mesh_12 = Mesh(move.Geometry)

# ---- group: Black Surface (continued)
mesh_13 = Mesh(Mesh=mesh_12, Material=standardmat_5, DecimalAccuracy=3)
